# Grasshopper definition yiqiao_wang_A-04.gh (Grasshopper 1.0.7)

# ----
# Geometry Pipeline
geometry_pipeline = GeometryPipeline(
    GroupByLayer=False,
    GroupByType=False,
    IncludeHidden=True,
    IncludeLocked=True,
    LayerFilter="Geometric_Filter_add",
    NameFilter="*",
    SublayerFiltering=True,
    TypeFilter=1073741848)
sunion = SolidUnion(Breps=geometry_pipeline)

is_additive = BooleanToggle(True)
geometry_pipeline_2 = GeometryPipeline(
    GroupByLayer=False,
    GroupByType=False,
    IncludeHidden=True,
    IncludeLocked=True,
    LayerFilter="Geometric_Filter_sub",
    NameFilter="*",
    SublayerFiltering=True,
    TypeFilter=1073741848)
wall_class = GhPythonScript()  # -> Wall
# ---------- wall_class: Python ----------
class Wall(object):
    def __init__(self, geometry, halfface, orientation="S", category=None):
        self.geometry = geometry
        self.halfface = halfface
        self.orientation = orientation
        self.category = category
# ---------- end wall_class ----------
is_additive_2 = BooleanToggle(False)
sunion_2 = SolidUnion(Breps=geometry_pipeline_2)

list = ValueList({"Union": 1, "Intersection": 2}, selected="Intersection")

bfilter = GhPythonScript(brep=sunion_2, is_additive=is_additive_2)  # -> bfilter; inputs brep: Brep
# ---------- bfilter: Python ----------
"""
### Main Task

Create a new kind of filter by implementing a new class. Use the examples above
as inspiration on how to convert the filters we have seen in previous weeks to classes!

This new filter will allow intuitive control over the design by leveraging a
geometric input. Specifically, the filter should use a Brep (referenced from Rhino)
to determine whether a point should be included in the final result.


We have prepared a geometry pipeline for you on the Grasshopper canvas, that 
automatically reads all Breps on the `Geometric_Filter` Rhino layer and combines 
it to a single Brep.

Your filter class should have one method `is_included` that takes 4 parameters 
as input: point and ix, iy, iz and returns `True` or `False` as output, indicating whether the 
specific point lies inside or outside the referenced Brep.
NOTE: it's important to understand the difference between the parameters `ix`, `iy`, `iz`
which are the indices relative to the grid's start (0,0,0), and the point, which will contain x, y and z
coordinates in 3d space and will be world-relative instead.
After completion you should be able to shape or sculpt your grid to your taste.

You can configure the filter to either keep the points where True is returned,
enabling an additive sculpting workflow, or remove those points, creating a
subtractive sculpting workflow. This gives you control over whether you're
"building up" geometry by including points or "carving out" geometry by
excluding them.

#### Details

- Create a class, for example, BrepFilter.
- Add a method `is_included` to it. This method should return `True` if the 
point is inside the Brep geometry, otherwise `False. (Or you can reverse this logic to taste)
- Right below the class, create an instance of it and assign it to the output 
of this component.
- Plug the component into the Stream filter to test its functionality.


#### Bonus (Not relevant for grading)

- Add a `__str__` magic method that returns a string describing the filter in a nice way.
- Create two filters, one for an additive sculpting workflow, and one for a subtractive one.


#### Functions, classes, methods and statements that you will need

- Class definition
- A class constructor (`__init__`).
- Attributes of a class. For the Brep filter, you will need to convert the Rhino Brep to a COMPAS Brep using `Brep.from_native()`.

#### Hints
- You will use the `Brep.from_native()` method to convert the Rhino Brep to a COMPAS Brep. The `Brep`  class of COMPAS needs to be imported from `compas.geometry`.
- You need to find a method that checks whether or not a point is contained within a brep
    - https://compas.dev/compas/latest/api/index.html
    - navigate to geometry > brep and look at the provided methods.
"""

# 0. Import everything we will need
# [ADD YOUR CODE HERE...]
from compas.geometry import Brep, Point
from compas_rhino.geometry.brep import RhinoBrep

# 1. Create a new class for the new filter
class BrepFilter(object):


    # 2. Add a constructor for the new class
    # [ADD YOUR CODE HERE...]
    def __init__(self, brep, is_additive=True):
        """
        initialize a brep filter to filter.
        If additive is true, then the geometries within the 
        """
        self.brep = Brep.from_native(brep)
        self.is_additive = is_additive

    # 3. Add a method that checks for inclusion in the filter
    # [ADD YOUR CODE HERE...]
    def __str__(self):
        if self.is_additive:
            return "additive brep filter"
        else:
            return "subtractive brep filter"
            
    def ToString(self):
        return self.__str__()

    def is_included(self, point, ix, iy, iz):
        """
        check if a certain point is included within this filter (self.brep).
        ix, iy, iz is not used in this case; they are just for unifying 
        the syntax between different kinds of filters.
        
        If the point is within the brep and we need additive filtering, True is returned;
        if the point is within the brep and we need subtractive filtering, False is returned.
        ...
        
        In table form:
        
        contains(point) is_additive is_included
        True            True        True
        True            False       False
        False           True        False
        False           False       False
        
        Therefore, == is used to match this table.
        """
        return self.brep.contains(point) == self.is_additive

# 4. Create an instance of the new filter class passing the input brep
#    and assign it to the output of this component
bfilter = BrepFilter(brep, is_additive)
# ---------- end bfilter ----------

list_2 = ValueList({"Union": 1, "Intersection": 2}, selected="Intersection")

# ---- group: Options
column_width_x = Slider(0.35, range=0.1..0.9)
column_depth_y = Slider(0.45, range=0.1..0.9)
slab_height = Slider(0.55, range=0.1..0.9)
main_beam_width = Slider(0.35, range=0.1..0.9)
main_beam_height = Slider(0.4, range=0.1..0.9)

# ---- group: Grid size
ny = Slider(14, range=0..30)
nz = Slider(20, range=0..20)
nx = Slider(16, range=0..20)

# ---- group: Cell sizes
xsize = Slider(7, range=0..20)
ysize = Slider(10, range=0..20)
zsize = Slider(4, range=0..20)

# ----
rotation = Slider(338, range=0..360)
n_balconies = Slider(150, range=0..400)
pt = Point(<point referenced from the Rhino model>)
colour_swatch = ColourSwatch(SwatchColor=RGB(255, 252, 250))  # disabled
colour_swatch_2 = ColourSwatch(SwatchColor=RGB(255, 125, 153))  # disabled

# ---- group: 2. Set file name
mustermann_max = Panel("yiqiao_wang")
assignment_nr = Panel("A-04")

# ---- group: 4. Set display options
toggle = BooleanToggle(False)
toggle_2 = BooleanToggle(False)

# ---- group: 5. Click button to save image
button = Button()

# ---- group: 3. Set image dimensions
height = Panel("2400")
width = Panel("3200")

# ---- group: 1. Select target directory
path = FilePath("C:\Users\wangy\Documents\GitHub\coding_architecture_hs24\assignments\A04-final-project\yiqiao_wang_A-04\")

# ----
python = GhPythonScript(
    path=path,
    name=mustermann_max,
    assignment_nr=assignment_nr,
    width=width,
    height=height,
    display_grid=toggle,
    display_grid_axes=toggle_2,
    save=button)  # -> out; inputs width: Int32, height: Int32
# ---------- python: Python ----------
import Rhino.Display as rd
import scriptcontext as sc
import System
import os

file_name = name + "_" + assignment_nr

def get_next_index(path):
    index = 1
    while os.path.exists(path + file_name + str(index) + ".png"):
        index += 1
    return index

def ViewCaptureToFile(path):
    view = sc.doc.Views.ActiveView
    if view:
        view_capture = rd.ViewCapture()
        view_capture.TransparentBackground = False
        view_capture.Width = view.ActiveViewport.Size.Width
        view_capture.Height = view.ActiveViewport.Size.Width
        view_capture.ScaleScreenItems = False
        view_capture.DrawAxes = True
        view_capture.DrawGrid = display_grid
        view_capture.DrawGridAxes = display_grid_axes
        size = System.Drawing.Size(view_capture.Width, view_capture.Height)
        size = System.Drawing.Size(width, height)
        
        settings = rd.ViewCaptureSettings(view, size, 72) # view, size, dpi
        settings.RasterMode = True
        settings.DrawGrid = display_grid
        settings.DrawAxis = display_grid_axes
        settings.DrawWallpaper = False
        index = get_next_index(path)
            
        filename = file_name + str(index)
        filename_with_extension = filename + ".png"
        bitmap = rd.ViewCapture.CaptureToBitmap(settings)
        fullpath = path + filename_with_extension
        bitmap.Save(fullpath)
        
        return filename_with_extension
        
        
if path is None:
    ghenv.Component.Message = "Please select a target directory first"
else:
    if save:
        path = ViewCaptureToFile(path)
        ghenv.Component.Message = "Saved image to " + path
# ---------- end python ----------

# ----
# Filter Classes
# Filter Selection
bfilter_2 = GhPythonScript(brep=sunion, is_additive=is_additive)  # -> bfilter; inputs brep: Brep; same code as bfilter
modulo_filter = GhPythonScript()  # -> mfilter
# ---------- modulo_filter: Python ----------
# Sample filter
class ModuleBasedFilter(object):
    def is_included(self, point, ix, iy, iz):
        if (ix + iy) % 2 == 0:
            return True

        return False

mfilter = ModuleBasedFilter()
# ---------- end modulo_filter ----------
random_filter = GhPythonScript()  # -> rfilter
# ---------- random_filter: Python ----------
# Sample filter
from random import choice

class RandomFilter(object):
    def is_included(self, point, ix, iy, iz):
        return choice([True, False])

rfilter = RandomFilter()
# ---------- end random_filter ----------
linear_filter = GhPythonScript()  # -> lfilter
# ---------- linear_filter: Python ----------
# Sample filter
class LinearFilter(object):
    def __init__(self, coefficient=1, vertical_shift_x=0, vertical_shift_y=0, horizontal_shift_x=0, horizontal_shift_y=0):
        super(LinearFilter, self).__init__()
        self.coefficient = coefficient
        self.vertical_shift_x = vertical_shift_x
        self.vertical_shift_y = vertical_shift_y
        self.horizontal_shift_x = horizontal_shift_x
        self.horizontal_shift_y = horizontal_shift_y

    def is_included(self, point, ix, iy, iz):
        z_range_x = (self.coefficient * ix + self.vertical_shift_x) + self.horizontal_shift_x
        z_range_y = (self.coefficient * iy + self.vertical_shift_y) + self.horizontal_shift_y
        return not z_range_x < iz > z_range_y

lfilter = LinearFilter(coefficient= 1.7, vertical_shift_x= -3, vertical_shift_y=-3, horizontal_shift_x=0, horizontal_shift_y=0)
# ---------- end linear_filter ----------
parab_filter = GhPythonScript()  # -> pfilter
# ---------- parab_filter: Python ----------
# Sample filter
class ParaboloidFilter(object):
    def __init__(self, coefficient, horizontal_shift_x, horizontal_shift_y, vertical_shift_x, vertical_shift_y):
        super(ParaboloidFilter, self).__init__()
        self.coefficient = coefficient
        self.vertical_shift_x = vertical_shift_x
        self.vertical_shift_y = vertical_shift_y
        self.horizontal_shift_x = horizontal_shift_x
        self.horizontal_shift_y = horizontal_shift_y


    # Paraboloid filter function
    def is_included(self, point, ix, iy, iz):
        z_paraboloid_x = (self.coefficient * ((ix + self.vertical_shift_x) ** 2 + (iy + self.vertical_shift_y) ** 2)) + self.horizontal_shift_x
        z_paraboloid_y = (self.coefficient * ((iy + self.vertical_shift_x) ** 2 + (ix + self.vertical_shift_x) ** 2)) + self.horizontal_shift_y
    
        # Check if the z value of the point is less than or equal to the z value of the paraboloid
        return z_paraboloid_x > iz < z_paraboloid_y

pfilter = ParaboloidFilter(coefficient=0.25, vertical_shift_x= -4, vertical_shift_y=4, horizontal_shift_x=0, horizontal_shift_y=1)
# ---------- end parab_filter ----------
value_list = ValueList({"Modulo filter": 0, "Random filter": 1, "Linear filter": 2, "Paraboloid filter": 3, "Brep filter": 4, "Merge filter": 5}, selected="Merge filter")

# ---- group: Challenge 02
mfilter = GhPythonScript(filter1=parab_filter, filter2=bfilter_2, mode=list)  # -> mfilter
# ---------- mfilter: Python ----------
class MergeFilter(object):
    def __init__(self, f1, f2, mode):
        self.f1 = f1
        self.f2 = f2
        self.mode = mode
        
    def is_included(self, point, ix, iy, iz):
        is_in1 = self.f1.is_included(point, ix, iy, iz)
        is_in2 = self.f2.is_included(point, ix, iy, iz)
        if mode == 1:
            return is_in1 or is_in2
        elif mode == 2:
            return is_in1 and is_in2
        else:
            error("mode must be either 1 (Union) or 2 (intersection)!")
        
    def __str__(self):
        return "merged filter between '{0}' and '{1}' using logic {2}".format(self.f1, self.f2, self.mode)
            
    def ToString(self):
        return self.__str__()
mfilter = MergeFilter(filter1, filter2, mode)
# ---------- end mfilter ----------

mfilter_2 = GhPythonScript(filter1=mfilter, filter2=bfilter, mode=list_2)  # -> mfilter; same code as mfilter

# ----
stream_filter = StreamFilter(
    Gate=value_list,
    Stream0=modulo_filter,
    Stream1=random_filter,
    Stream2=linear_filter,
    Stream3=parab_filter,
    Stream4=bfilter_2,
    Stream5=mfilter_2)

# ----
# Applying classes to create buildings
mainbeam_class = GhPythonScript()  # -> MainBeam
# ---------- mainbeam_class: Python ----------
class MainBeam(object):
    def __init__(self, geometry, edge, category=None):
        self.geometry = geometry
        self.edge = edge
        self.category = category
# ---------- end mainbeam_class ----------
slab_class = GhPythonScript()  # -> Slab
# ---------- slab_class: Python ----------
# Create the Slab class here
class Slab(object):
    def __init__(self, geometry, halfface, category=None):
        self.geometry = geometry
        self.halfface = halfface
        self.category = category
# ---------- end slab_class ----------
column_class = GhPythonScript()  # -> Column
# ---------- column_class: Python ----------
class Column(object):
    def __init__(self, geometry, edge, category=None):
        self.geometry = geometry
        self.edge = edge
        self.category = category
# ---------- end column_class ----------

balcony_class = GhPythonScript(MainBeam=mainbeam_class, Column=column_class, Slab=slab_class)  # -> Balcony
# ---------- balcony_class: Python ----------
from compas.geometry import Box
from compas.geometry import Frame
from compas.geometry import Vector, Translation
import copy


class Balcony(object):
    def __init__(
        self,
        length,
        height,
        halfface_idx,
        volmesh,
        slab_thickness=0.1,
        beam_width=0.1,
        beam_height=0.2,
        column_length=0.1,
        column_width=0.1,
        handrail_width=0.05,
        handrail_height=0.1,
    ):
        """
        Create a balcony that is attached to an exposed halfface of a volmesh.

        The balcony recognizes a naked vertical halfface, and extrude a cube (Volmesh) from it to the outside.
        It contains:
        - a floor slab on the bottom,
        - two columns on the outside of the balcony,
        - three beams on the bottom and three handrails on the top.

        If the viewer is facing the facade from outside of the building,
        the lower left corner of the facade is p0 (self.points[0]), the lower right corner of the facade is p1.
        Then p2 and p3 are upper right and upper left corners of the facade, forming an anticlockwise order.
        p0 to p3 are all points on the halfface/facade.

        p4 is on the same location as p0, but it's the point that is extruded to the outside of the building.
        following the same anti-clockwise order, p5, p6, p7 is defined. Same order is applied to the frames.

        :param length: length of the cantiliver of the balcony
        :type length: float
        :param height: height of the handrail of the balcony, relative to the floor slab. Normally an open balcony has a height of 1.1m
        :type height: float
        :param halfface_idx: index of the halfface that the balcony is attached to. Used to locate the halfface on the volmesh
        :type halfface_idx: int
        :param volmesh: a volmesh of the building, where the halfface belongs to
        :type volmesh: compas.datastructures.VolMesh
        :raises ValueError: if halfface is not exposed, it means that the surface is not an external surface, so no balcony can be created
        :raises ValueError: if the halfface is not vertical, it means that the surface is not a wall, so no balcony can be created
        """
        # check if the halfface is naked
        if not volmesh.is_halfface_on_boundary(halfface_idx):
            raise ValueError("The halfface is not naked.")

        # check if halfface normal is horizontal
        normal = volmesh.halfface_normal(halfface_idx).inverted()
        if normal.dot(Vector.Zaxis()) != 0:
            raise ValueError("The halfface is not vertical, no balcony can be created.")

        self.main_volmesh = volmesh
        self.attached_halfface_idx = halfface_idx

        p0, p1 = self.get_halfface_lower_two_points(
            self.attached_halfface_idx, self.main_volmesh
        )
        width = p0.distance_to_point(p1)
        vx = normal.unitized() * length/2
        vy = Vector.from_start_end(p0, p1).unitized() * width/2
        vz = Vector.Zaxis() * height/2

        points = self.get_balcony_points(p0, p1, length, height)
        frame0 = Frame(points[0], vx, vy)
        frames = []
        for point in points:
            frame = copy.deepcopy(frame0)
            frame.point = point
            frames.append(frame)
        beam_04 = MainBeam(
            Box(length, beam_width, beam_height, frames[0]).translated(vx), None, "balcony_beam"
        )
        beam_15 = MainBeam(
            Box(length, beam_width, beam_height, frames[1]).translated(vx), None, "balcony_beam"
        )
        beam_45 = MainBeam(
            Box(beam_width, width, beam_height, frames[4]).translated(vy), None, "balcony_beam"
        )
        # slab will be formed on the bottom of the balcony
        slab = Slab(
            Box(length, width, zsize=slab_thickness, frame=frames[0]).translated(vx+vy),
            None,
            "balcony_slab",
        )
#        slab.translation(
        # handrail will be formed on the top of the balcony
        handrail_37 = MainBeam(
            Box(length, handrail_width, handrail_height, frames[3]).translated(vx),
            None,
            "balcony_handrail",
        )
        handrail_26 = MainBeam(
            Box(length, handrail_width, handrail_height, frames[2]).translated(vx),
            None,
            "balcony_handrail",
        )
        handrail_76 = MainBeam(
            Box(handrail_width, width, handrail_height, frames[7]).translated(vy),
            None,
            "balcony_handrail",
        )
        
        column_47 = Column(
            Box(column_length, column_width, height, frames[4]), None, "balcony_column"
        )
        column_47.geometry.frame.point.z += height/2
        column_56 = Column(
            Box(column_length, column_width, height, frames[5]), None, "balcony_column"
        )
        column_56.geometry.frame.point.z += height/2

        self.beams = [beam_04, beam_15, beam_45, handrail_37, handrail_26, handrail_76]
        self.columns = [column_47, column_56]
        self.slabs = [slab]
        self.points = points
        self.frames = frames

    @staticmethod
    def get_halfface_lower_two_points(halfface_idx, volmesh):
        """
        The function identifies the outside of halfface, and returns a tuple of two points, p0 and p1. This can be used to
        locate the balcony on the facade.

        :return: return the lower left and lower right points of the halfface
        :rtype: tuple of Point
        """
        # check if halfface is vertical
        normal = volmesh.halfface_normal(halfface_idx).inverted()

        points = volmesh.face_points(halfface_idx)
        # find the two points with the lowest z value
        lower_points = []
        for point in points:
            if len(lower_points) < 2:
                lower_points.append(point)
            else:
                if point.z < lower_points[0].z:
                    lower_points[0] = point
                elif point.z < lower_points[1].z:
                    lower_points[1] = point

        # also make sure that the normal of the halfface cross product with the vector of the two points is pointing upwards
        # so that (normal, (points[0] -> points[1]), Zaxis) is a right-hand coordinate system
        if normal.cross(lower_points[1] - lower_points[0]).dot(Vector.Zaxis()) < 0:
            lower_points[0], lower_points[1] = lower_points[1], lower_points[0]

        return lower_points[0], lower_points[1]

    def get_balcony_points(self, p0, p1, length, height):
        """
        Calculate the points of a balcony given two initial points, length, and height.

        :param p0: The starting point of the balcony (lower left corner).
        :type p0: Point
        :param p1: The ending point of the balcony (lower right corner).
        :type p1: Point
        :param length: The length of the cantilever of the balcony.
        :type length: float
        :param height: The height of the balcony.
        :type height: float
        :return: A list of 8 points representing the balcony.
        :rtype: list of Point
        """

        vy = Vector.from_start_end(p0, p1)
        vx = vy.cross(Vector.Zaxis()).unitized()
        t_x = Translation.from_vector(vx * length)
        t_z = Translation.from_vector(Vector.Zaxis() * height)
        p2 = p1.transformed(t_z)
        p3 = p0.transformed(t_z)
        p4 = p0.transformed(t_x)
        p5 = p1.transformed(t_x)
        p6 = p2.transformed(t_x)
        p7 = p3.transformed(t_x)
        return [p0, p1, p2, p3, p4, p5, p6, p7]

    def number_of_columns(self):
        return len(self.columns)

    def number_of_main_beams(self):
        return len(self.main_beams)

    def calculate_volume(self):
        pass


if __name__ == "__main__":
    pass
# ---------- end balcony_class ----------

buildinggrid_class = GhPythonScript(MainBeam=mainbeam_class, Column=column_class, Slab=slab_class, Wall=wall_class, Balcony=balcony_class)  # -> BuildingGrid
# ---------- buildinggrid_class: Python ----------
import copy
import math
import random
from compas.geometry import Box
from compas.geometry import Frame
from compas.geometry import Line
from compas.geometry import Point
from compas.geometry import Vector
from compas.datastructures import VolMesh


# The building grid class contains both data (attributes)
# of our grid and also its behavior (methods)
class BuildingGrid(object):
    def __init__(
        self, xsize, ysize, zsize, point, rotation, nx, ny, nz, selected_filter
    ):
        self.init_params = locals()
        self.ref_frame = Frame(point)
        self.ref_frame.rotate(rotation, point=point)
        self.volmesh = self.create_volmesh(
            selected_filter, xsize, ysize, zsize, point, rotation, nx, ny, nz
        )
        self.columns = []
        self.main_beams = []
        self.slabs = []
        self.walls = []
        self.internal_walls = []

    def generate_slabs(self, slab_height):
        # 1. Reset slabs list to an empty list
        self.slabs = []
        for face in self.volmesh.faces():
            normal = self.volmesh.face_normal(face)
            dot_product = normal.dot(Vector.Zaxis())
            if dot_product in (1, -1):
                # face is facing upwards or downwards, create a slab
                points = self.volmesh.face_points(face)
                # box = Box.from_corner_corner_height(points[0], points[2], slab_height)
                frame = Frame.from_points(points[0], points[1], points[2])
                # move the frame to the center of face
                frame.point = self.volmesh.face_centroid(face)
                frame.point.z -= slab_height / 2
                xsize = points[1].distance_to_point(points[0])
                ysize = points[2].distance_to_point(points[1])
                box = Box(xsize, ysize, slab_height, frame=frame)

                cell_id_opposite = self.volmesh.halfface_opposite_cell(face)
                if cell_id_opposite is None:
                    if dot_product == 1:  # bottom face
                        slab = Slab(box, face, "bottom_slab")
                    else:  # top face
                        slab = Slab(box, face, "roof")
                else:
                    slab = Slab(box, face, "floor_slab")

                self.slabs.append(slab)

    def generate_facades(self, thickness, skipped_faces=[], external=True):
        # 1. Reset the list of walls and assign facade_thickness to an attribute
        # ... your code here ...
        if external:
            self.walls = []
        else:
            self.internal_walls = []

        for face in self.volmesh.halffaces():
            if face in skipped_faces:
                continue
            if external and self.volmesh.is_halfface_on_boundary(face):
                wall = self.generate_wall_from_face(face, thickness, "facade")
                if wall:
                    self.walls.append(wall)
            elif not external and not self.volmesh.is_halfface_on_boundary(face):
                wall = self.generate_wall_from_face(face, thickness, "internal_wall")
                if wall:
                    self.internal_walls.append(wall)

    def generate_wall_from_face(self, face, thickness, category):
        face_normal = self.volmesh.halfface_normal(face)

        if abs(face_normal.dot(Vector.Zaxis())) < 1e-5:

            face_points = self.volmesh.face_points(face)
            face_centroid = self.volmesh.face_centroid(face)
            frame = copy.deepcopy(self.ref_frame)
            frame.point = face_centroid

            height = abs(face_points[0].z - face_centroid.z) * 2
            p0, p1 = Balcony.get_halfface_lower_two_points(face, self.volmesh)
            width = p0.distance_to_point(p1)
            if abs(face_normal.dot(frame.yaxis)) < 1e-5:
                box = Box(thickness, width, height, frame=frame)
                orientation = "y"
            else:
                box = Box(width, thickness, height, frame=frame)
                orientation = "x"
            wall = Wall(box, face, orientation=orientation, category=category)
            return wall
        else:
            return None

    # Generate columns and append them to the self.columns attribute
    def generate_columns(self, column_width_x, column_depth_y):
        self.column_width_x = column_width_x
        self.column_depth_y = column_depth_y

        # First reset the list of columns
        self.columns = []

        # Now generate columns
        for uv in self.volmesh.edges():
            # If the edge vector is parallel to unit vector Z...
            edge_vector = self.volmesh.edge_direction(uv)

            if (
                edge_vector.dot(Vector.Zaxis()) == 1
            ):  # edge vector is always pointing upwards if it's vertical
                # ...we add a column
                edge_midpoint = self.volmesh.edge_point(uv)
                edge_length = self.volmesh.edge_length(uv)
                frame = copy.deepcopy(self.ref_frame)
                frame.point = edge_midpoint

                box = Box(column_width_x, column_depth_y, edge_length, frame=frame)

                column = Column(box, uv, "building_column")
                self.columns.append(column)

    # This method is provided as is
    # It shows how to create main beams
    # Main beams are a nbit more complicated than columns
    # because they need to be adjusted in length to match the column
    def generate_main_beams(self, main_beam_width, main_beam_height):
        # First reset the list of main beams
        self.main_beams = []

        for uv in self.volmesh.edges():
            edge_vector = self.volmesh.edge_direction(uv)

            if edge_vector.dot(Vector.Zaxis()) == 0:

                start, end = self.volmesh.edge_coordinates(uv)
                line = Line(start, end)

                # Shorten the beam to fit the columns
                if edge_vector.dot(Vector.Xaxis()) in (1, -1):
                    shift_value = self.column_width_x
                else:
                    shift_value = self.column_depth_y

                # Create the box in the origin of world XY frame
                box = Box.from_width_height_depth(
                    main_beam_width, main_beam_height, line.length - shift_value
                )
                # frame = Frame(
                #     line.midpoint, edge_vector.cross(Vector.Zaxis()), edge_vector
                # )
                frame = copy.deepcopy(self.ref_frame)
                frame.xaxis = edge_vector.cross(Vector.Zaxis())
                frame.y_axis = edge_vector
                frame.point = line.midpoint
                frame.point.z -= main_beam_height / 2

                # Move box to correct frame
                box.frame = frame

                mainbeam = MainBeam(box, uv)
                self.main_beams.append(mainbeam)

    def create_volmesh(
        self, selected_filter, xsize, ysize, zsize, point, rotation, nx, ny, nz
    ):
        volmesh = VolMesh()
        vertex_keys = dict()
        x0 = point.x
        y0 = point.y
        z0 = point.z

        for ix in range(nx):
            for iy in range(ny):
                for iz in range(nz):
                    corner_1 = Point(ix * xsize + x0, iy * ysize + y0, iz * zsize + z0)
                    corner_2 = Point(corner_1.x + xsize, corner_1.y + ysize, corner_1.z)
                    #                    corner_1.rotate(rotation, point=point)
                    #                    corner_2.rotate(rotation, point=point)
                    box = Box.from_corner_corner_height(corner_1, corner_2, zsize)
                    box.rotate(rotation, point=point)
                    # Only add cell if within filter
                    if selected_filter.is_included(box.corner(0), ix, iy, iz):
                        #                        box = Box.from_corner_corner_height(corner_1, corner_2, zsize)
                        #                        box.rotate(rotation, point=point)
                        corner_points = box.compute_vertices()
                        vertices = []

                        for v in corner_points:
                            gkey = str(v)
                            if gkey not in vertex_keys:
                                vertex_keys[gkey] = volmesh.add_vertex(
                                    x=v[0], y=v[1], z=v[2]
                                )

                            vertex = vertex_keys[gkey]
                            vertices.append(vertex)

                        a, b, c, d, e, f, g, h = vertices
                        faces = [
                            [a, d, c, b],  # bottom face
                            [a, e, f, d],  # front face
                            [a, b, h, e],  # left face
                            [b, c, g, h],  # back face
                            [d, f, g, c],  # right face
                            [e, h, g, f],  # top face
                        ]

                        # Add the cell with the defined faces
                        volmesh.add_cell(faces, attr_dict=dict(ix=ix, iy=iy, iz=iz))

        return volmesh

    def get_exposed_faces(self, vertical=True, horizontal=False):
        """
        Get the indices of the exposed faces of the building (volmesh).

        :param vertical: if vertical exposed surfaces should be included, defaults to True
        :type vertical: bool, optional
        :param horizontal: if horizontal exposed surfaces should be included, defaults to False
        :type horizontal: bool, optional
        :return: list of exposed face indices
        :rtype: list of int
        """
        exposed_face_indices = []
        for face in self.volmesh.faces():
            if self.volmesh.is_halfface_on_boundary(face):
                normal = self.volmesh.halfface_normal(face)
                if vertical and normal.dot(Vector.Zaxis()) == 0:
                    exposed_face_indices.append(face)
                if horizontal and normal.dot(Vector.Zaxis()) in (1, -1):
                    exposed_face_indices.append(face)
        return exposed_face_indices

    def add_balcony(self, halfface_idx, length, height):
        balcony = Balcony(length, height, halfface_idx, self.volmesh)
        self.slabs.extend(balcony.slabs)
        self.main_beams.extend(balcony.beams)
        self.columns.extend(balcony.columns)

    def generate_balconies(self, min_length, max_length, height, n_balconies, **kwargs):
        """
        randomly generate n balconies on the exposed faces of the building (volmesh).
        The cantiliver length of the balcony decreases with the height of the building.

        :param min_length: minimal length of the cantiliver of the balcony
        :type min_length: float
        :param max_length: maximal length of the cantiliver of the balcony
        :type max_length: float
        :param height: _description_
        :type height: _type_
        :param n_balconies: _description_
        :type n_balconies: _type_

        :return: list of indices of the faces where balconies are added
        :rtype: list of int
        """
        exposed_faces = self.get_exposed_faces(vertical=True, horizontal=False)
        # randomly choosing n_balconies faces from the exposed faces without repetition
        n_exposed_faces = len(exposed_faces)
        n_balconies = min(n_balconies, n_exposed_faces)
        selected_faces = random.sample(exposed_faces, n_balconies)
        # get the height of the building
        building_height = self.init_params["zsize"] * (self.init_params["nz"] + 1)
        for face in selected_faces:
            # get the centroid of face to understand the height of balcony
            centroid = self.volmesh.halfface_centroid(face)
            # the higher the balcony, the smaller the length. But minimal length is 1
            length = min_length + max(
                0, (max_length - min_length) * (centroid.z / building_height)
            )
            self.add_balcony(face, length, height, **kwargs)
        return selected_faces

    def number_of_columns(self):
        return len(self.columns)

    def number_of_main_beams(self):
        return len(self.main_beams)

    def calculate_volume(self, element, category=None):
        volume = 0
        if element == "column":
            for column in self.columns:
                if category is None or column.category == category:
                    volume += column.geometry.volume
        elif element == "beam":
            for beam in self.main_beams:
                if category is None or beam.category == category:
                    volume += beam.geometry.volume
        elif element == "slab":
            for slab in self.slabs:
                if category is None or slab.category == category:
                    volume += slab.geometry.volume
        elif element == "wall":
            for wall in self.walls:
                if category is None or wall.category == category:
                    volume += wall.geometry.volume
        elif element == "internal_wall":
            for internal_wall in self.internal_walls:
                if category is None or internal_wall.category == category:
                    volume += internal_wall.geometry.volume
        else:
            raise ValueError("element type not allowed!")
        return volume

    def calculate_area(self, element, category=None):
        area = 0
        if element == "column":
            for column in self.columns:
                if category is None or column.category == category:
                    area += column.geometry.xsize * column.geometry.ysize
        elif element == "beam":
            for beam in self.main_beams:
                if category is None or beam.category == category:
                    area += beam.geometry.xsize * beam.geometry.ysize
        elif element == "slab":
            for slab in self.slabs:
                if category is None or slab.category == category:
                    area += slab.geometry.xsize * slab.geometry.ysize
        elif element == "wall":
            for wall in self.walls:
                if category is None or wall.category == category:
                    if wall.orientation == "x":
                        area += wall.geometry.xsize * wall.geometry.zsize
                    elif wall.orientation == "y":
                        area += wall.geometry.ysize * wall.geometry.zsize
                    else:
                        raise ValueError("wall orientation not recognized!")
        elif element == "internal_wall":
            for internal_wall in self.internal_walls:
                if category is None or internal_wall.category == category:
                    if internal_wall.orientation == "x":
                        area += (
                            internal_wall.geometry.xsize * internal_wall.geometry.zsize
                        )
                    elif internal_wall.orientation == "y":
                        area += (
                            internal_wall.geometry.ysize * internal_wall.geometry.zsize
                        )
                    else:
                        raise ValueError("wall orientation not recognized!")
        else:
            raise ValueError("element type not allowed!")
        return area


if __name__ == "__main__":
    pass
# ---------- end buildinggrid_class ----------

# ----
# Create instance of building grid
filter = Data(stream_filter)
buildinggrid = Data(buildinggrid_class)
create_building = GhPythonScript(
    nx=nx,
    ny=ny,
    nz=nz,
    xsize=xsize,
    ysize=ysize,
    zsize=zsize,
    point=pt,
    rotation=rotation,
    selected_filter=filter,
    main_beam_width=main_beam_width,
    main_beam_height=main_beam_height,
    column_width_x=column_width_x,
    column_depth_y=column_depth_y,
    slab_height=slab_height,
    facade_thickness=Slider(0.1, range=0..0.1),
    BuildingGrid=buildinggrid,
    min_length=Slider(0.6, range=0..3),
    max_length=Slider(9, range=0..20),
    n_balconies=n_balconies)  # -> grid; inputs nx: Int32, ny: Int32, nz: Int32, point: Point3d
# ---------- create_building: Python ----------
from compas.geometry import Point
import math

point = Point(point.X, point.Y, point.Z) # convert rhino point to compass point
rotation = math.radians(rotation % 360) # convert degree to radian
# Create an instance of our building grid
grid = BuildingGrid(xsize, ysize, zsize, point, rotation, nx, ny, nz, selected_filter)

grid.generate_columns(column_width_x, column_depth_y)
grid.generate_main_beams(main_beam_width, main_beam_height)

grid.generate_slabs(slab_height)
faces_with_balconies = grid.generate_balconies(min_length, max_length, 1.1, int(n_balconies))
grid.generate_facades(facade_thickness, faces_with_balconies)
grid.generate_facades(facade_thickness, external=False)
# ---------- end create_building ----------

area_calculation = GhPythonScript(grid=create_building)  # -> a_internal_walls, a_facades, a_slab, a_roof
# ---------- area_calculation: Python ----------
a_internal_walls = grid.calculate_area("internal_wall")
a_facades = grid.calculate_area("wall")
a_slab = grid.calculate_area("slab")
a_roof = grid.calculate_area("slab", "roof")
# ---------- end area_calculation ----------
volume_calculation = GhPythonScript(grid=create_building)  # -> v_columns, v_beams, v_internal_walls, v_facades, v_slab
# ---------- volume_calculation: Python ----------
__author__ = "wangy"
__version__ = "2024.11.29"

v_columns = grid.calculate_volume("column")
v_beams = grid.calculate_volume("beam")
v_internal_walls = grid.calculate_volume("internal_wall")
v_facades = grid.calculate_volume("wall")
v_slab = grid.calculate_volume("slab")
# ---------- end volume_calculation ----------
area_of_roofs = Panel(area_calculation.a_roof)
volume_of_beams = Panel(volume_calculation.v_beams)
volume_of_columns = Panel(volume_calculation.v_columns)
volume_of_internal_walls = Panel(volume_calculation.v_internal_walls)
area_of_slabs = Panel(area_calculation.a_slab)
area_of_facade = Panel(area_calculation.a_facades)
volume_of_facade = Panel(volume_calculation.v_facades)
area_of_internal_walls = Panel(area_calculation.a_internal_walls)

# ---- group: Cells
number_slider = Slider(0, range=0..5000)  # disabled
# Visualization
grid = Data(create_building)  # disabled
colour_swatch_3 = ColourSwatch(SwatchColor=RGB(41, 115, 111))  # disabled
cells = GhPythonScript(i=number_slider, grid=grid)  # -> cells; disabled
# ---------- cells: Python ----------
from compas_rhino.conversions import mesh_to_rhino

cells = []
for x in grid.volmesh.cells():
    if x < i:
        cells.append(mesh_to_rhino(grid.volmesh.cell_to_mesh(x)))
# ---------- end cells ----------
custom_preview = CustomPreview(Geometry=cells, Material=colour_swatch_3)  # disabled

# ---- group: Columns
columns = GhPythonScript(grid=create_building)  # -> columns; disabled
# ---------- columns: Python ----------
# We use this direct conversion instead of the component
# because we want the Box BREP instead of the meshes
from compas_rhino.conversions import box_to_rhino

columns = []

for column in grid.columns:
    column = box_to_rhino(column.geometry)
    columns.append(column)
# ---------- end columns ----------
colour_swatch_4 = ColourSwatch(SwatchColor=RGB(84, 24, 24))  # disabled
custom_preview_2 = CustomPreview(Geometry=columns, Material=colour_swatch_4)  # disabled

# ---- group: Main beams
main_beams = GhPythonScript(grid=create_building)  # -> mainbeams; disabled
# ---------- main_beams: Python ----------
# We use this direct conversion instead of the component
# because we want the Box BREP instead of the meshes
from compas_rhino.conversions import box_to_rhino

mainbeams = []

for mainbeam in grid.main_beams:
    b = box_to_rhino(mainbeam.geometry)
    mainbeams.append(b)
# ---------- end main_beams ----------
colour_swatch_5 = ColourSwatch(SwatchColor=RGB(252, 129, 35))  # disabled
custom_preview_3 = CustomPreview(Geometry=main_beams, Material=colour_swatch_5)  # disabled

# ----
facades = GhPythonScript(grid=create_building)  # -> facades; disabled
# ---------- facades: Python ----------
# We use this direct conversion instead of the component
# because we want the Box BREP instead of the meshes
from compas_rhino.conversions import box_to_rhino

facades = []

for wall in grid.walls:
    b = box_to_rhino(wall.geometry)
    facades.append(b)
# ---------- end facades ----------

colour_swatch_6 = ColourSwatch(SwatchColor=RGB(255, 231, 145))  # disabled
colour_swatch_7 = ColourSwatch(SwatchColor=RGB(235, 208, 188))  # disabled
colour_swatch_8 = ColourSwatch(SwatchColor=RGB(92, 167, 247))  # disabled
merge = Merge(Data1=colour_swatch_6, Data2=colour_swatch_7, Data3=colour_swatch_8)  # disabled
slabs = GhPythonScript(grid=create_building, available_colors=merge)  # -> slabs, colors; inputs available_colors: list; disabled
# ---------- slabs: Python ----------
# We use this direct conversion instead of the component
# because we want the Box BREP instead of the meshes
from compas_rhino.conversions import box_to_rhino

slabs = []
colors = []

for slab in grid.slabs:
    box = box_to_rhino(slab.geometry)
    
    if slab.category == "roof":
        colors.append(available_colors[0])
    elif slab.category == "bottom_slab":
        colors.append(available_colors[1])
    else:
        colors.append(available_colors[2])
        
    slabs.append(box)
# ---------- end slabs ----------
custom_preview_4 = CustomPreview(Geometry=slabs.slabs, Material=slabs.colors)  # disabled

# ----
# Challenge 02
pt_2 = Point(Point(83.81634951, 0, 0))  # disabled
number_slider_2 = Slider(10, range=1..75)  # disabled
number_slider_3 = Slider(10, range=1..75)  # disabled
number_slider_4 = Slider(8.895, range=0..10)  # disabled
number_slider_5 = Slider(9.09, range=0..10)  # disabled
number_slider_6 = Slider(0.7, range=0..10)  # disabled
colour_swatch_9 = ColourSwatch(SwatchColor=RGB(145, 134, 15))  # disabled
slabs_2 = GhPythonScript(
    grid=create_building,
    stack_point=pt_2,
    max_height=number_slider_2,
    row_limit=number_slider_3,
    x_offset=number_slider_4,
    y_offset=number_slider_5,
    z_offset=number_slider_6)  # -> stacked_slabs, stacked_slabs_original; inputs stack_point: Point3d, max_height: Int32; disabled
# ---------- slabs_2: Python ----------
"""
## Challenge 02

Goal: Visualize all the slabs in our building grid in a stacked or "palletized" version.

The idea is to take all the slabs that are created in the building, and 
make a copy of and visualize them in stacks of slabs, as if they were in
pallets for transportation.

#### Details

The algorithm that we need to implement, as well as hints to functions
you might need, is in code comments, as a step-by-step guide.

"""
from compas_rhino.conversions import box_to_rhino
from compas.geometry import Point
import copy


# 1. Create an empty list to store the stacked slabs
stacked_slabs = []
slabs_roof = []
slabs_bottom = []
slabs_floor = []
slabs_sorted = []
stacked_slabs_original = []

for slab in grid.slabs:
    if slab.category == "roof":
        slabs_roof.append(slab)
    elif slab.category == "bottom_slab":
        slabs_bottom.append(slab)
    else:
        slabs_floor.append(slab)

slabs_sorted = slabs_roof + slabs_bottom + slabs_floor
# 2. Iterate over all slabs
#    Hint: since you will need both the slab instance and the index of
#          it to calculate position, use the enumerate() method of python
#          if you don't want to keep a separate counter variable
for idx, slab in enumerate(slabs_sorted):

    # 3. For each slab, we need to find out in which row and column
    #    of pallets to place it. 
    """
    Since we only have row limit and max height, the column can be expanded infinitely.
    The slabs will be piled up (z) in the first row (x), first column (y) until max height.
    Then it fills the second row, first column until max height.
    """
    
    # n_fullpiles accounts for how many full piles of slabs have already been stacked.
    # the remainder iz is the height (z-position) of the current slab
    n_fullpiles, iz = divmod(idx, max_height)
    
    """
    full pile of slabs fill up all the rows (along the column) before moving to the next column
    so the number of columns iy is the result of devision, while number of rows ix is the remainder.
    take the following example:
    * * *
    * * *
    * * *
    * * o
    * *
    The point o is on the third column (because there are already two filled up columns)
    and on the fourth row (the remainder is 4)
    """
    iy, ix = divmod(n_fullpiles, row_limit)
    
    # 4. Calculate x, y, z coordinates based on the starting stack_point 
    #    and the results calculated above
    x = ix * x_offset
    y = iy * y_offset
    z = iz * z_offset

    # 5. Copy the slab's geometry! We don't want to modify the one in the building
    slab_copy = copy.deepcopy(slab)
    
    # 6. Assign x, y, z to the copied geometry
    # ... your code here ...
    slab_copy.geometry.frame.point = Point(stack_point.X+x, stack_point.Y+y, stack_point.Z+z)

    
    # 7. Convert to a rhino box and append to list
    # ... your code here ...
    box_rhino = box_to_rhino(slab_copy.geometry)
    stacked_slabs.append(box_rhino)
    stacked_slabs_original.append(slab_copy)
# ---------- end slabs_2 ----------
custom_preview_5 = CustomPreview(Geometry=slabs_2.stacked_slabs, Material=colour_swatch_9)  # disabled

facades_2 = GhPythonScript(grid=create_building)  # -> internal_walls; disabled
# ---------- facades_2: Python ----------
# We use this direct conversion instead of the component
# because we want the Box BREP instead of the meshes
from compas_rhino.conversions import box_to_rhino

internal_walls = []

for wall in grid.internal_walls:
    b = box_to_rhino(wall.geometry)
    internal_walls.append(b)
# ---------- end facades_2 ----------
custom_preview_6 = CustomPreview(Geometry=facades, Material=colour_swatch)  # disabled
custom_preview_7 = CustomPreview(Geometry=facades_2, Material=colour_swatch_2)  # disabled

colour_swatch_10 = ColourSwatch(SwatchColor=RGBA(235, 208, 188, 173))  # disabled
colour_swatch_11 = ColourSwatch(SwatchColor=RGBA(178, 145, 255, 135))  # disabled
colour_swatch_12 = ColourSwatch(SwatchColor=RGBA(92, 167, 247, 131))  # disabled
merge_2 = Merge(Data1=colour_swatch_11, Data2=colour_swatch_10, Data3=colour_swatch_12)  # disabled
slabs_3 = GhPythonScript(slabs=slabs_2.stacked_slabs_original, available_colors=merge_2)  # -> slabs_rhino, colors; inputs slabs: list, available_colors: list; disabled
# ---------- slabs_3: Python ----------
# We use this direct conversion instead of the component
# because we want the Box BREP instead of the meshes
from compas_rhino.conversions import box_to_rhino

slabs_rhino = []
colors = []

for slab in slabs:
    print(slab.category)
    box = box_to_rhino(slab.geometry)
    
    if slab.category == "roof":
        colors.append(available_colors[0])
    elif slab.category == "bottom_slab":
        colors.append(available_colors[1])
    else:
        colors.append(available_colors[2])
        
    slabs_rhino.append(box)
# ---------- end slabs_3 ----------
custom_preview_8 = CustomPreview(Geometry=slabs_3.slabs_rhino, Material=slabs_3.colors)  # disabled
